# Grasshopper definition memorama.gh (Grasshopper 0.9.80)

# caras del total de los rueditas
panel = Panel("16")
multiplication = Multiplication(A="4", B=panel)
radio_0 = Slider(7.5, range=0..10)
radio_1 = Slider(11, range=0..14)
pressure_angle = Slider(16, range=2..180)
series = Series(Start=0, Step=1, Count=multiplication)
number_slider = Slider(1, range=0..10)
number_slider_2 = Slider(0, range=0..1)
integer_division = IntegerDivision(A=series, B=panel)
mod = Modulus(A=series, B=panel)
subtraction = Subtraction(A=radio_1, B=radio_0)

# ---- group: combinacion (c/2e)%2
pow = Power(A="2", B=integer_division)
integer_division_2 = IntegerDivision(A=mod, B=pow)
mod_2 = Modulus(A=integer_division_2, B="2")
multiplication_2 = Multiplication(A=mod_2, B=subtraction)
addition = Addition(A=radio_0, B=multiplication_2)

# ---- group: ancho del paso
ancho_de_paso = Slider(4.442, range=0..10)

# ----
# pi x 2 = 360 (para hacer el giro total)
panel_2 = Panel("2")
pi = Pi(Factor=simplify(panel_2))
division = Division(A=pi, B=panel)
multiplication_3 = Multiplication(A=mod, B=division)
multiplication_4 = Multiplication(A=integer_division, B=ancho_de_paso)

# ---- group: puntos
pt = PointPolar(BasePlane=PlaneXY(0, 0, 0), XYAngle=0, ZAngle=0, Offset=addition)
pt_2 = PointPolar(BasePlane=PlaneXY(0, 0, 0), XYAngle=division, ZAngle=0, Offset=addition)
pt_3 = ConstructPoint(XCoordinate=0, YCoordinate=0, ZCoordinate=0)

# ----
vec = VectorXYZ(XComponent=0, YComponent=0, ZComponent=multiplication_4)  # -> Vector, Length
vec_2 = VectorXYZ(XComponent=0, YComponent=0, ZComponent=ancho_de_paso)  # -> Vector, Length
pressure_angle_2 = Slider(15, range=2..180)
clearance = Slider(0.2, range=0..2)
addendum = Slider(0.6, range=0..10)
srf4pt = _4PointSurface(CornerA=pt_2, CornerB=pt, CornerC=pt_3)
extr = Extrude(Base=srf4pt, Direction=vec_2.Vector)
rotate = Rotate(Geometry=extr, Angle=multiplication_3, Plane=PlaneXY(0, 0, 0))  # -> Geometry, Transform
move = Move(Geometry=rotate.Geometry, Motion=vec.Vector)  # -> Geometry, Transform
number_slider_3 = Slider(1.8, range=0.01..20)
num = Number(ancho_de_paso)
inner_radius = Slider(13, range=0..20)
cap = CapHoles(Brep=move.Geometry)

# ---- group: cilindro del centro
inner_radius_2 = Slider(4.3, range=0..10)
multiplication_5 = Multiplication(A="4", B=ancho_de_paso)
cyl = Cylinder(Base=PlaneXY(0, 0, 0), Radius=inner_radius_2, Length=multiplication_5)
sdiff = SolidDifference(BrepsA=cap, BrepsB=cyl)

# ----
pressure_angle_3 = Number(pressure_angle_2)
altura_total = Number(multiplication_5)
addendum_2 = Number(addendum)
clearance_2 = Number(clearance)
subtraction_2 = Subtraction(A=multiplication_5, B=num)
pressure_angle_4 = Number(pressure_angle_2)
division_2 = Division(A=subtraction_2, B=2)
clearance_3 = Number(clearance)
addendum_3 = Number(addendum)
cyl_2 = Cylinder(Base=PlaneXY(0, 0, 0), Radius=inner_radius, Length=num)
pressure_angle_5 = Number(pressure_angle_2)
addendum_4 = Number(addendum)
clearance_4 = Number(clearance)
vec_3 = VectorXYZ(XComponent=0, YComponent=0, ZComponent=Slider(0.001, range=0..0.001))  # -> Vector, Length
join = BrepJoin(Breps=sdiff)  # -> Breps, Closed
move_2 = Move(Geometry=cyl_2, Motion=vec_3.Vector)  # -> Geometry, Transform
cap_2 = CapHoles(Brep=move_2.Geometry)
capex = CapHolesEx(Brep=join.Breps)  # -> Brep, Caps, Solid
cap_3 = CapHoles(Brep=join.Breps)
sunion = SolidUnion(Breps=capex.Brep)
sdiff_2 = SolidDifference(BrepsA=cap_3, BrepsB=cap_2)
eje_barilla = Slider(3.3, range=0..10)
eje_barilla_2 = Slider(-1.3, range=-5..5)

# ---- group: arandelas laterales
eje_engranaje = Slider(6.3, range=0..10)
eje_engranaje_2 = Slider(-2, range=-5..1)
cyl_3 = Cylinder(Base=PlaneXY(0, 0, 0), Radius=eje_barilla, Length=Slider(62, range=0..65))
cyl_4 = Cylinder(Base=PlaneXY(0, 0, 0), Radius=eje_barilla, Length=Slider(1, range=0..1))
cap_4 = CapHoles(Brep=cyl_3)
cap_5 = CapHoles(Brep=cyl_4)
offset = Offset(Surface=cyl_3, Distance=eje_barilla_2, Retrim=True)
offset_2 = Offset(Surface=cyl_4, Distance=eje_barilla_2, Retrim=True)
sdiff_3 = SolidDifference(BrepsA=cap_4, BrepsB=offset)
sdiff_4 = SolidDifference(BrepsA=cap_5, BrepsB=offset_2)
cap_6 = CapHoles(Brep=sdiff_3)
cap_7 = CapHoles(Brep=sdiff_4)
brep = Brep(cap_6)
brep_2 = Brep(cap_7)

# ---- group: agujero
cir = Circle(Plane=PlaneXY(0, 0, 0), Radius=Slider(4.29, range=0..10))
vec_4 = VectorXYZ(XComponent=Slider(23.6, range=0..100), YComponent=0, ZComponent=Slider(-11.102, range=-20..10))  # -> Vector, Length
move_3 = Move(Geometry=cir, Motion=vec_4.Vector)  # -> Geometry, Transform
Z = UnitZ(Factor=Slider(50, range=0..100))
extr_2 = Extrude(Base=move_3.Geometry, Direction=Z)
brep_3 = Brep(extr_2)

# ---- group: engranaje correa
number_slider_4 = Slider(2.36, range=0..3)
number_slider_5 = Slider(4.3, range=0..10)
number_slider_6 = Slider(11, range=0..20)
espesor_engranaje = Number(ancho_de_paso)
dientes = Number(Slider(12, range=0..50))
engranaje_correa = EngranajeCentral(
    modulo=number_slider_4,
    espesor_engranaje=altura_total,
    dientes=Slider(8, range=0..10),
    radio_eje=number_slider_5,
    pressure_angle=pressure_angle_4,
    clearance=clearance_3,
    addendum=addendum_3,
    teethslim=1)  # -> radioprimitivo_2, B
vec_5 = VectorXYZ(XComponent=0, YComponent=0, ZComponent=0)  # -> Vector, Length

# ----
engranaje = EngranajeCentral(
    modulo=number_slider_4,
    espesor_engranaje=num,
    dientes=Slider(8, range=0..100),
    radio_eje=inner_radius_2,
    pressure_angle=pressure_angle_3,
    clearance=clearance_2,
    addendum=addendum_2,
    teethslim=1)  # -> radioprimitivo_2, B
subtraction_3 = Subtraction(A=espesor_engranaje, B=0.3)

# ---- group: engranaje correa (continued)
engranaje_central = EngranajeCentral(
    modulo=number_slider_4,
    espesor_engranaje=subtraction_3,
    dientes=dientes,
    radio_eje=number_slider_5,
    pressure_angle=pressure_angle_5,
    clearance=clearance_4,
    addendum=addendum_4,
    teethslim=1.25)  # -> radioprimitivo_2, B
move_4 = Move(Geometry=engranaje_central.B, Motion=vec_5.Vector)  # -> Geometry, Transform
sunion_2 = SolidUnion(Breps=[move_4.Geometry, engranaje_correa.B])

# ----
subtraction_4 = Subtraction(A=altura_total, B=espesor_engranaje)
move_5 = Move(Geometry=engranaje.B, Motion=vec_3.Vector)  # -> Geometry, Transform
expression = Expression(x=subtraction_4, Expression="x/2")
brep_4 = Brep([move_5.Geometry, sdiff_2])

# ---- group: soporte derecho
espesor_ext = Slider(4, range=0..10)
espesor_int = Slider(27, range=0..30)
addition_2 = Addition(A=engranaje_central.radioprimitivo_2, B=engranaje.radioprimitivo_2)
cluster = Cluster_2(
    distancia_tornillo=Slider(20, range=-50..100),
    rotacion_triangulo=Slider(137, range=0..360),
    altura_soporte_externo=espesor_ext,
    altura_buje_interno=espesor_int,
    separacion_ejes=addition_2)
brep_5 = Brep(cluster)

# ---- group: soporte izq
cluster_2 = Cluster_2(
    distancia_tornillo=Slider(15, range=-50..100),
    rotacion_triangulo=Slider(137, range=0..360),
    altura_soporte_externo=espesor_ext,
    altura_buje_interno=Slider(24, range=0..100),
    separacion_ejes=addition_2)
brep_6 = Brep(cluster_2)

# ----
sint = SolidIntersection(BrepsA=brep_6, BrepsB=brep_3)
brep_7 = Brep(brep_5)

# ---- group: engranaje motor
altura_total_2 = Number(multiplication_5)
number_slider_7 = Slider(8, range=0..10)
number_slider_8 = Slider(3, range=0..10)
subtraction_5 = Subtraction(A=altura_total_2, B=espesor_engranaje)
number_slider_9 = Slider(-4, range=-10..10)
number_slider_10 = Slider(1.7, range=0..5)
pressure_angle_6 = Number(pressure_angle_2)
clearance_5 = Number(clearance)
addendum_5 = Number(addendum)
rectangle = Rectangle(Plane=PlaneXY(0, 0, 0), XSize=number_slider_7, YSize=number_slider_8, Radius=0)  # -> Rectangle, Length
addition_3 = Addition(A=number_slider_8, B=number_slider_10)
rectangle_2 = Rectangle(Plane=PlaneXY(0, 0, 0), XSize=number_slider_7, YSize=number_slider_8, Radius=0)  # -> Rectangle, Length
neg = Negative(Value=addition_3)
vec_6 = VectorXYZ(XComponent=number_slider_9, YComponent=number_slider_10, ZComponent=0)  # -> Vector, Length
vec_7 = VectorXYZ(XComponent=number_slider_9, YComponent=neg, ZComponent=0)  # -> Vector, Length

# ----
subtraction_6 = Subtraction(A=subtraction_5, B=5)

# ---- group: engranaje motor (continued)
vec_8 = VectorXYZ(XComponent=0, YComponent=0, ZComponent=subtraction_6)  # -> Vector, Length
vec_9 = VectorXYZ(XComponent=0, YComponent=0, ZComponent=subtraction_6)  # -> Vector, Length
extr_3 = Extrude(Base=rectangle.Rectangle, Direction=vec_8.Vector)
engranaje_moto = EngranajeCentral(
    modulo=number_slider_4,
    espesor_engranaje=subtraction_6,
    dientes=number_slider_6,
    radio_eje=Slider(2.8, range=0..10),
    pressure_angle=pressure_angle_6,
    clearance=clearance_5,
    addendum=addendum_5,
    teethslim=1)  # -> radioprimitivo_2, B
extr_4 = Extrude(Base=rectangle_2.Rectangle, Direction=vec_9.Vector)
move_6 = Move(Geometry=extr_3, Motion=vec_6.Vector)  # -> Geometry, Transform
move_7 = Move(Geometry=extr_4, Motion=vec_7.Vector)  # -> Geometry, Transform
cap_8 = CapHoles(Brep=move_6.Geometry)
cap_9 = CapHoles(Brep=move_7.Geometry)

# ----
sunion_3 = SolidUnion(Breps=[cap_9, cap_8, engranaje_moto.B])
brep_8 = Brep(sunion_3)

# ---- group: prisma central
number_slider_11 = Slider(3, range=0..10)
number_slider_12 = Slider(10, range=0..10)
addition_4 = Addition(A=engranaje_central.radioprimitivo_2, B=engranaje.radioprimitivo_2)
prisma_agujereado = PrismaAgujereado(X=Slider(10, range=0..10), Y=Slider(10, range=0..10), H=number_slider_11, B=cyl)  # -> agujero_2, R
prisma_agujereado_2 = PrismaAgujereado(X=number_slider_12, Y=Slider(10, range=0..10), H=number_slider_11, B=cyl)  # -> agujero_2, R
rectangle_3 = Rectangle(Plane=PlaneXY(0, 0, 0), XSize=number_slider_12, YSize=Slider(40, range=0..100), Radius=0)  # -> Rectangle, Length
division_3 = Division(A=number_slider_12, B=Slider(-2, range=-2..10))
boxrec = BoxRectangle(Rectangle=rectangle_3.Rectangle, Height=number_slider_11)
vec_10 = VectorXYZ(XComponent=0, YComponent=addition_4, ZComponent=0)  # -> Vector, Length
multiplication_6 = Multiplication(A=number_slider_12, B=0.5)
vec_11 = VectorXYZ(XComponent=0, YComponent=Slider(1, range=0..5), ZComponent=0)  # -> Vector, Length
vec_12 = VectorXYZ(XComponent=division_3, YComponent=0, ZComponent=0)  # -> Vector, Length
move_8 = Move(Geometry=prisma_agujereado_2.R, Motion=vec_10.Vector)  # -> Geometry, Transform
move_9 = Move(Geometry=boxrec, Motion=vec_12.Vector)  # -> Geometry, Transform
move_10 = Move(Geometry=prisma_agujereado_2.agujero_2, Motion=vec_10.Vector)  # -> Geometry, Transform
pi_2 = Pi(Factor=Slider(0.5, range=0..1))
sdiff_5 = SolidDifference(BrepsA=move_9.Geometry, BrepsB=[prisma_agujereado.agujero_2, move_10.Geometry])
altura_total_3 = Number(multiplication_5)
sunion_4 = SolidUnion(Breps=[prisma_agujereado.R, sdiff_5, move_8.Geometry])
pi_3 = Pi(Factor=Slider(0.5, range=0..1))
vec_13 = VectorXYZ(XComponent=0, YComponent=Slider(1, range=0..1), ZComponent=0)  # -> Vector, Length
rot3d = Rotate3D(Geometry=sunion_4, Angle=pi_3, Center=Point(0, 0, 0), Axis=vec_13.Vector)  # -> Geometry, Transform

# ----
x2tambores = Multiplication(A=altura_total_3, B=2)

# ---- group: prisma central (continued)
addition_5 = Addition(A=x2tambores, B=number_slider_11)
rectangle_4 = Rectangle(Plane=PlaneXY(0, 0, 0), XSize=number_slider_12, YSize=addition_5, Radius=0)  # -> Rectangle, Length
boxrec_2 = BoxRectangle(Rectangle=rectangle_4.Rectangle, Height=number_slider_11)
rot3d_2 = Rotate3D(Geometry=boxrec_2, Angle=pi_2, Center=Point(0, 0, 0), Axis=vec_11.Vector)  # -> Geometry, Transform
rot3d_3 = Rotate3D(Geometry=rot3d_2.Geometry, Angle=1.570796327, Center=Point(0, 0, 0), Axis=Vector(0, 0, 1))  # -> Geometry, Transform
vec_14 = VectorXYZ(XComponent=addition_5, YComponent=0, ZComponent=0)  # -> Vector, Length
move_11 = Move(Geometry=rot3d.Geometry, Motion=vec_14.Vector)  # -> Geometry, Transform

# ---- group: prisma central / prisma central y
vec_15 = VectorXYZ(XComponent=addition_5, YComponent=Slider(37, range=0..100), ZComponent=multiplication_6)  # -> Vector, Length

# ---- group: prisma central (continued)
move_12 = Move(Geometry=rot3d_3.Geometry, Motion=vec_15.Vector)  # -> Geometry, Transform
brep_9 = Brep([move_11.Geometry, move_12.Geometry, rot3d.Geometry])

# ==== cluster EngranajeCentral
espesor_engranaje = ClusterInput()
radio_eje = ClusterInput()
modulo = ClusterInput()
dientes = ClusterInput()
pressure_angle = ClusterInput()
modulo_2 = Number(modulo)
dientes_2 = Integer(dientes)
radio_eje_2 = Number(radio_eje)
clearance = ClusterInput()
vec = VectorXYZ(XComponent=0, YComponent=0, ZComponent=0)  # -> Vector, Length
espesor_engranaje_2 = Number(espesor_engranaje)
multiplication = Multiplication(A=modulo_2, B=dientes_2)
addendum = ClusterInput()
teethslim = ClusterInput()
division = Division(A=multiplication, B="2")
radioprimitivo = Number(division)
cluster = Cluster(
    num=pressure_angle,
    center=vec.Vector,
    number_of_teeth=dientes,
    clearance=clearance,
    addendum=addendum,
    teethslim=teethslim)
radioprimitivo_2 = ClusterOutput(radioprimitivo)
scale = Scale(Geometry=cluster, Center=Point(0, 0, 0), Factor=modulo_2)  # -> Geometry, Transform
boundary = BoundarySurfaces(Edges=scale.Geometry)
vec_2 = VectorXYZ(XComponent=0, YComponent=0, ZComponent=espesor_engranaje_2)  # -> Vector, Length
cyl = Cylinder(Base=PlaneXY(0, 0, 0), Radius=radio_eje_2, Length=vec_2.Length)
extr = Extrude(Base=boundary, Direction=vec_2.Vector)
sdiff = SolidDifference(BrepsA=extr, BrepsB=cyl)
cap = CapHoles(Brep=sdiff)
B = ClusterOutput(cap)

# ==== cluster PrismaAgujereado
Y = ClusterInput()
X = ClusterInput()
H = ClusterInput()
B = ClusterInput()
division = Division(A=Y, B=-2)
division_2 = Division(A=X, B=-2)
rectangle = Rectangle(Plane=PlaneXY(0, 0, 0), XSize=X, YSize=Y, Radius=0)  # -> Rectangle, Length
vec = VectorXYZ(XComponent=division_2, YComponent=division, ZComponent=0)  # -> Vector, Length
boxrec = BoxRectangle(Rectangle=rectangle.Rectangle, Height=H)
move = Move(Geometry=boxrec, Motion=vec.Vector)  # -> Geometry, Transform
agujero = Brep(B)
sdiff = SolidDifference(BrepsA=move.Geometry, BrepsB=B)
R = ClusterOutput(sdiff)
agujero_2 = ClusterOutput(agujero)

# ==== cluster Cluster_2
rotacion_triangulo = ClusterInput()
altura_soporte_externo = ClusterInput()
distancia_tornillo = ClusterInput()
altura_buje_interno = ClusterInput()
separacion_ejes = ClusterInput()
rotacion_triangulo_2 = Number(rotacion_triangulo)
distancia_tornillo_2 = Number(distancia_tornillo)
altura_buje_interno_2 = Number(altura_buje_interno)
separacion_ejes_2 = Number(separacion_ejes)
altura_soporte_externo_2 = Number(altura_soporte_externo)

# ---- group: techito
techito = Techito(altura=altura_soporte_externo_2)
X = UnitX(Factor=Slider(40.5, range=0..50))
brep = Brep(techito)
move = Move(Geometry=brep, Motion=X)  # -> Geometry, Transform

# ---- group: soporte individual
number_slider = Slider(30, range=0..100)
number_slider_2 = Slider(12.6, range=0..100)
number_slider_3 = Slider(4.3, range=0..10)
number_slider_4 = Slider(5.9, range=0..10)
cir_ext = Circle(Plane=PlaneXY(0, 0, 0), Radius=number_slider_2)
number_slider_5 = Slider(0.8, range=0..1)
vec = VectorXYZ(XComponent=separacion_ejes_2, YComponent=0, ZComponent=0)  # -> Vector, Length
scale_nu = ScaleNU(Geometry=cir_ext, Plane=PlaneXY(0, 0, 0), ScaleX=number_slider_5, ScaleY=number_slider_5, ScaleZ=1)  # -> Geometry, Transform
vec_2 = VectorXYZ(XComponent=distancia_tornillo_2, YComponent=0, ZComponent=0)  # -> Vector, Length
cir = Circle(Plane=PlaneXY(0, 0, 0), Radius=Slider(1.8, range=0..10))
move_2 = Move(Geometry=scale_nu.Geometry, Motion=vec.Vector)  # -> Geometry, Transform
srf = Surface([cir_ext, move_2.Geometry])
move_3 = Move(Geometry=cir, Motion=vec_2.Vector)  # -> Geometry, Transform
srf_2 = Surface(move_3.Geometry)
rad = Radians(Degrees=rotacion_triangulo_2)
vec_3 = VectorXYZ(XComponent=0, YComponent=0, ZComponent=altura_soporte_externo_2)  # -> Vector, Length
brep_2 = Brep()

# ---- group: soporte individual / triangle
multiplication = Multiplication(A=number_slider_2, B=-1)
pt = ConstructPoint(XCoordinate=0, YCoordinate=number_slider_2, ZCoordinate=0)
pt_2 = ConstructPoint(XCoordinate=0, YCoordinate=multiplication, ZCoordinate=0)
pt_3 = ConstructPoint(XCoordinate=number_slider, YCoordinate=0, ZCoordinate=0)
pline = PolyLine(Vertices=[pt, pt_2, pt_3], Closed=Toggle(True))

# ---- group: soporte individual / int circle
cir_2 = Circle(Plane=PlaneXY(0, 0, 0), Radius=number_slider_3)
vec_4 = VectorXYZ(XComponent=0, YComponent=0, ZComponent=altura_buje_interno_2)  # -> Vector, Length
cir_3 = Circle(Plane=PlaneXY(0, 0, 0), Radius=number_slider_4)
extr = Extrude(Base=cir_2, Direction=vec_4.Vector)
extr_2 = Extrude(Base=cir_3, Direction=vec_4.Vector)
cap = CapHoles(Brep=extr)
cap_2 = CapHoles(Brep=extr_2)

# ---- group: soporte individual (continued)
sdiff = SolidDifference(BrepsA=cap_2, BrepsB=cap)
srf_3 = Surface(pline)
move_4 = Move(Geometry=sdiff, Motion=vec.Vector)  # -> Geometry, Transform
sdiff_2 = SolidDifference(BrepsA=srf_3, BrepsB=srf_2)
rotate = Rotate(Geometry=sdiff_2, Angle=rad, Plane=PlaneXY(0, 0, 0))  # -> Geometry, Transform
sunion = SolidUnion(Breps=[rotate.Geometry, srf])
extr_3 = Extrude(Base=sunion, Direction=vec_3.Vector)

# ----
sunion_2 = SolidUnion(Breps=[move_4.Geometry, sdiff, extr_3, move.Geometry])
R = ClusterOutput(sunion_2)

# ==== cluster Cluster
center = ClusterInput()
center_2 = Point(center)
number_of_teeth = ClusterInput()
clearance = ClusterInput()
addendum = ClusterInput()
teethslim = ClusterInput()
number_of_teeth_2 = Number(number_of_teeth)
clearance_2 = Number(clearance)
addendum_2 = Number(addendum)
num = ClusterInput()
teethslim_2 = Number(teethslim)
num_2 = Number(num)
pitch_diameter = Evaluate(F="x", x=number_of_teeth_2)
pitch_diameter_2 = Number(pitch_diameter)
pitch_diameter_3 = Number(pitch_diameter_2)
pitch_radius = Evaluate(F="X/2", x=pitch_diameter)
circle = CircleCNR(Center=center_2, Normal=Vector(0, 0, 1), Radius=expr("x/2", pitch_diameter_3))
diametiral_pitch_new = Division(A=number_of_teeth_2, B=pitch_diameter)
base_radius = Evaluate(F="p*COS(rad(pa))", p=pitch_radius, pa=num_2)
addendum_3 = Division(A=addendum_2, B=diametiral_pitch_new)
gear_tooth_spacing = Evaluate(F="360/x", x=number_of_teeth_2)
dedendum = Addition(A=addendum_3, B=clearance_2)
root_radius = Evaluate(F="x-Y", x=pitch_radius, y=dedendum)
evaluate = Evaluate(F="x/4", x=gear_tooth_spacing)
outside_radius = Evaluate(F="x+y", x=pitch_radius, y=addendum_3)
series = Series(Start=0, Step=gear_tooth_spacing, Count=number_of_teeth_2)
pitch_circle = Circle(circle)
outsidecircle = CircleCNR(Center=center_2, Normal=Vector(0, 0, 1), Radius=outside_radius)
base_circle = CircleCNR(Center=center_2, Normal=Vector(0, 0, 1), Radius=base_radius)
rad = Radians(Degrees=evaluate)
rad_2 = Radians(Degrees=series)
rad_3 = Radians(Degrees=gear_tooth_spacing)
min_radius = Maximum(A=base_radius, B=root_radius)
root_circle = CircleCNR(Center=center_2, Normal=Vector(0, 0, 1), Radius=root_radius)
center_3 = Point(center_2)
circle_2 = CircleCNR(Center=center_2, Normal=Vector(0, 0, 1), Radius=min_radius)
resolution = Slider(7, range=5..300)
division = Division(A=rad, B=teethslim_2)
base_radius_2 = Number(base_radius)
range = Range(Domain=Domain(0, 90), Steps=resolution)
involute_x = F2(Function="r*sin(rad(theta))+(r*(π/2-(rad(theta)))*(sin((rad(theta))+π/2)))", X=base_radius_2, Theta=range)
involute_x_2 = F2(Function="r*cos(rad(theta))+(r*(π/2-(rad(theta)))*(cos((rad(theta))+π/2)))", X=base_radius_2, Theta=range)
pt = PointXYZ(XComponent=involute_x_2, YComponent=involute_x, ZComponent=0, System=PlaneXY(0, 0, 0))
intcrv = Interpolate(Vertices=pt, Degree=3, Periodic=False, KnotStyle=1)  # -> Curve, Length, Domain
evaluate_2 = Evaluate(F="x/2", x=rad_3)
trim = TrimWithRegion(Curve=intcrv.Curve, Region=outsidecircle)  # -> Inside, Outside
crv = Curve(trim.Inside)
end = EndPoints(Curve=crv)  # -> Start, End
ccx = CurveCurve(CurveA=crv, CurveB=pitch_circle)  # -> Points, ParamsA, ParamsB
ln = Line(StartPoint=ccx.Points, EndPoint=center_3)
rotate = Rotate(Geometry=ln, Angle=expr("-x", division), Plane=PlaneXY(0, 0, 0))  # -> Geometry, Transform
rotate_2 = Rotate(Geometry=rotate.Geometry, Angle=expr("-x", evaluate_2), Plane=PlaneXY(0, 0, 0))  # -> Geometry, Transform
rotate_3 = Rotate(Geometry=rotate.Geometry, Angle=evaluate_2, Plane=PlaneXY(0, 0, 0))  # -> Geometry, Transform
mirror = MirrorCurve(Geometry=crv, Curve=rotate.Geometry, Tangent=True)
end_2 = EndPoints(Curve=mirror)  # -> Start, End
ln_2 = Line(StartPoint=end_2.End, EndPoint=center_3)
ccx_2 = CurveCurve(CurveA=root_circle, CurveB=rotate_3.Geometry)  # -> Points, ParamsA, ParamsB
ccx_3 = CurveCurve(CurveA=root_circle, CurveB=rotate_2.Geometry)  # -> Points, ParamsA, ParamsB
top_ln = Line(StartPoint=end.Start, EndPoint=end_2.Start)
ln_3 = Line(StartPoint=end.End, EndPoint=center_3)
trim_2 = TrimWithRegion(Curve=ln_3, Region=root_circle)  # -> Inside, Outside
trim_3 = TrimWithRegion(Curve=ln_2, Region=root_circle)  # -> Inside, Outside
crv_2 = Curve(trim_2.Outside)
crv_3 = Curve(trim_3.Outside)
join = JoinCurves(Curves=flatten([crv_2, crv, mirror, crv_3, top_ln]), Preserve=False)
trim_4 = TrimWithRegion(Curve=join, Region=root_circle)  # -> Inside, Outside
end_3 = EndPoints(Curve=trim_4.Outside)  # -> Start, End
ln_4 = Line(StartPoint=end_3.Start, EndPoint=ccx_2.Points)
ln_5 = Line(StartPoint=end_3.End, EndPoint=ccx_3.Points)
flatten = FlattenTree(Data=ln_5, Path="{0}")
flatten_2 = FlattenTree(Data=ln_4, Path="{0}")
flatten_3 = FlattenTree(Data=trim_4.Outside, Path="{0}")
join_2 = JoinCurves(Curves=[flatten_3, flatten_2, flatten], Preserve=False)
rotate_4 = Rotate(Geometry=join_2, Angle=rad_2, Plane=PlaneXY(0, 0, 0))  # -> Geometry, Transform
join_3 = JoinCurves(Curves=rotate_4.Geometry, Preserve=False)
C = ClusterOutput(join_3)

# ==== cluster Techito
altura = ClusterInput()
altura_2 = Number(altura)
number_slider = Slider(-37, range=-37..100)
number_slider_2 = Slider(8, range=0..10)
number_slider_3 = Slider(37, range=0..100)
number_slider_4 = Slider(-45, range=-50..10)
pt = ConstructPoint(XCoordinate=0, YCoordinate=number_slider_3, ZCoordinate=0)
pt_2 = ConstructPoint(XCoordinate=0, YCoordinate=number_slider, ZCoordinate=0)
number_slider_5 = Slider(2.15, range=0..5)
number_slider_6 = Slider(3.96, range=0..10)
pt_3 = ConstructPoint(XCoordinate=number_slider_4, YCoordinate=Slider(8, range=0..10), ZCoordinate=0)
pt_4 = ConstructPoint(XCoordinate=number_slider_4, YCoordinate=Slider(-8, range=-20..10), ZCoordinate=0)
pt_5 = ConstructPoint(XCoordinate=Slider(23, range=0..100), YCoordinate=0, ZCoordinate=0)
pt_6 = ConstructPoint(XCoordinate=number_slider_2, YCoordinate=number_slider, ZCoordinate=0)
pt_7 = ConstructPoint(XCoordinate=number_slider_2, YCoordinate=number_slider_3, ZCoordinate=0)
addition = Addition(A=number_slider_5, B=1)
cir = Circle(Plane=PlaneXY(0, 0, 0), Radius=number_slider_5)
X = UnitX(Factor=Slider(18, range=0..30))
cir_2 = Circle(Plane=PlaneXY(0, 0, 0), Radius=number_slider_5)
vec = VectorXYZ(XComponent=number_slider_6, YComponent=Slider(32.5, range=0..100), ZComponent=0)  # -> Vector, Length
cir_3 = Circle(Plane=PlaneXY(0, 0, 0), Radius=number_slider_5)
vec_2 = VectorXYZ(XComponent=number_slider_6, YComponent=Slider(-32.5, range=-35..100), ZComponent=0)  # -> Vector, Length
cir_4 = Circle(Plane=PlaneXY(0, 0, 0), Radius=addition)
addition_2 = Addition(A=altura_2, B=1)
move = Move(Geometry=cir_2, Motion=vec.Vector)  # -> Geometry, Transform
move_2 = Move(Geometry=cir_3, Motion=vec_2.Vector)  # -> Geometry, Transform
move_3 = Move(Geometry=cir, Motion=X)  # -> Geometry, Transform
pline = PolyLine(Vertices=[pt_3, pt, pt_7, pt_5, pt_6, pt_2, pt_4], Closed=Toggle(True))
Z = UnitZ(Factor=addition_2)
move_4 = Move(Geometry=cir_4, Motion=vec_2.Vector)  # -> Geometry, Transform
move_5 = Move(Geometry=cir_4, Motion=vec.Vector)  # -> Geometry, Transform
move_6 = Move(Geometry=cir_4, Motion=X)  # -> Geometry, Transform
Z_2 = UnitZ(Factor=altura_2)
srf = Surface(move.Geometry)
srf_2 = Surface(move_2.Geometry)
srf_3 = Surface(move_3.Geometry)
srf_4 = Surface(pline)
extr = Extrude(Base=move_4.Geometry, Direction=Z)
extr_2 = Extrude(Base=move_5.Geometry, Direction=Z)
extr_3 = Extrude(Base=srf, Direction=Z)
extr_4 = Extrude(Base=srf_2, Direction=Z)
extr_5 = Extrude(Base=srf_4, Direction=Z_2)
extr_6 = Extrude(Base=move_6.Geometry, Direction=Z)
extr_7 = Extrude(Base=srf_3, Direction=Z)
cap = CapHoles(Brep=extr)
cap_2 = CapHoles(Brep=extr_2)
cap_3 = CapHoles(Brep=extr_6)
sdiff = SolidDifference(BrepsA=cap, BrepsB=extr_4)
sdiff_2 = SolidDifference(BrepsA=cap_3, BrepsB=extr_7)
sdiff_3 = SolidDifference(BrepsA=cap_2, BrepsB=extr_3)
sdiff_4 = SolidDifference(BrepsA=extr_5, BrepsB=[extr_4, extr_3, extr_7])
R = ClusterOutput([sdiff_4, sdiff, sdiff_3, sdiff_2])
