# Grasshopper definition repuesto_engranaje_carro.gh (Grasshopper 0.9.80)

pressure_angle = Slider(16, range=2..180)
number_slider = Slider(1, range=0..10)
number_slider_2 = Slider(0, range=0..1)
pressure_angle_2 = Slider(19, range=2..180)

# ---- group: ancho del paso
ancho_de_paso = Slider(1, range=0..10)

# ----
clearance = Slider(-0.13, range=-2..2)
addendum = Slider(1, range=0..10)
number_slider_3 = Slider(3.1, range=0..10)
espesor_engranaje = Number(ancho_de_paso)
cyl = Cylinder(Base=PlaneXY(0, 0, 0), Radius=number_slider_3, Length=Slider(6, range=0..10))
cone = Cone(Base=PlaneXY(0, 0, 0), Radius=Slider(11, range=0..20), Length=Slider(7, range=0..10))  # -> Cone, Tip
dientes = Number(Slider(20, range=0..50))
pressure_angle_3 = Number(pressure_angle_2)
addendum_2 = Number(addendum)
clearance_2 = Number(clearance)
engranaje_central = EngranajeCentral(
    modulo=Slider(1.37, range=0..3),
    espesor_engranaje=espesor_engranaje,
    dientes=dientes,
    radio_eje=number_slider_3,
    pressure_angle=pressure_angle_3,
    clearance=clearance_2,
    addendum=addendum_2,
    teethslim=Slider(0.75, range=0..4))  # -> radioprimitivo_2, B
sdiff = SolidDifference(BrepsA=cone.Cone, BrepsB=cyl)
sunion = SolidUnion(Breps=[sdiff, engranaje_central.B])
brep = Brep(sunion)

# ==== cluster EngranajeCentral
espesor_engranaje = ClusterInput()
radio_eje = ClusterInput()
modulo = ClusterInput()
dientes = ClusterInput()
pressure_angle = ClusterInput()
modulo_2 = Number(modulo)
dientes_2 = Integer(dientes)
radio_eje_2 = Number(radio_eje)
clearance = ClusterInput()
vec = VectorXYZ(XComponent=0, YComponent=0, ZComponent=0)  # -> Vector, Length
espesor_engranaje_2 = Number(espesor_engranaje)
multiplication = Multiplication(A=modulo_2, B=dientes_2)
addendum = ClusterInput()
teethslim = ClusterInput()
division = Division(A=multiplication, B="2")
radioprimitivo = Number(division)
cluster = Cluster(
    num=pressure_angle,
    center=vec.Vector,
    number_of_teeth=dientes,
    clearance=clearance,
    addendum=addendum,
    teethslim=teethslim)
radioprimitivo_2 = ClusterOutput(radioprimitivo)
scale = Scale(Geometry=cluster, Center=Point(0, 0, 0), Factor=modulo_2)  # -> Geometry, Transform
boundary = BoundarySurfaces(Edges=scale.Geometry)
vec_2 = VectorXYZ(XComponent=0, YComponent=0, ZComponent=espesor_engranaje_2)  # -> Vector, Length
cyl = Cylinder(Base=PlaneXY(0, 0, 0), Radius=radio_eje_2, Length=vec_2.Length)
extr = Extrude(Base=boundary, Direction=vec_2.Vector)
sdiff = SolidDifference(BrepsA=extr, BrepsB=cyl)
cap = CapHoles(Brep=sdiff)
B = ClusterOutput(cap)

# ==== cluster Cluster
center = ClusterInput()
center_2 = Point(center)
number_of_teeth = ClusterInput()
clearance = ClusterInput()
addendum = ClusterInput()
teethslim = ClusterInput()
number_of_teeth_2 = Number(number_of_teeth)
clearance_2 = Number(clearance)
addendum_2 = Number(addendum)
num = ClusterInput()
teethslim_2 = Number(teethslim)
num_2 = Number(num)
pitch_diameter = Evaluate(F="x", x=number_of_teeth_2)
pitch_diameter_2 = Number(pitch_diameter)
pitch_diameter_3 = Number(pitch_diameter_2)
pitch_radius = Evaluate(F="X/2", x=pitch_diameter)
circle = CircleCNR(Center=center_2, Normal=Vector(0, 0, 1), Radius=expr("x/2", pitch_diameter_3))
diametiral_pitch_new = Division(A=number_of_teeth_2, B=pitch_diameter)
base_radius = Evaluate(F="p*COS(rad(pa))", p=pitch_radius, pa=num_2)
addendum_3 = Division(A=addendum_2, B=diametiral_pitch_new)
gear_tooth_spacing = Evaluate(F="360/x", x=number_of_teeth_2)
dedendum = Addition(A=addendum_3, B=clearance_2)
root_radius = Evaluate(F="x-Y", x=pitch_radius, y=dedendum)
evaluate = Evaluate(F="x/4", x=gear_tooth_spacing)
outside_radius = Evaluate(F="x+y", x=pitch_radius, y=addendum_3)
series = Series(Start=0, Step=gear_tooth_spacing, Count=number_of_teeth_2)
pitch_circle = Circle(circle)
outsidecircle = CircleCNR(Center=center_2, Normal=Vector(0, 0, 1), Radius=outside_radius)
base_circle = CircleCNR(Center=center_2, Normal=Vector(0, 0, 1), Radius=base_radius)
rad = Radians(Degrees=evaluate)
rad_2 = Radians(Degrees=series)
rad_3 = Radians(Degrees=gear_tooth_spacing)
min_radius = Maximum(A=base_radius, B=root_radius)
root_circle = CircleCNR(Center=center_2, Normal=Vector(0, 0, 1), Radius=root_radius)
center_3 = Point(center_2)
circle_2 = CircleCNR(Center=center_2, Normal=Vector(0, 0, 1), Radius=min_radius)
resolution = Slider(7, range=5..300)
division = Division(A=rad, B=teethslim_2)
base_radius_2 = Number(base_radius)
range = Range(Domain=Domain(0, 90), Steps=resolution)
involute_x = F2(Function="r*sin(rad(theta))+(r*(π/2-(rad(theta)))*(sin((rad(theta))+π/2)))", X=base_radius_2, Theta=range)
involute_x_2 = F2(Function="r*cos(rad(theta))+(r*(π/2-(rad(theta)))*(cos((rad(theta))+π/2)))", X=base_radius_2, Theta=range)
pt = PointXYZ(XComponent=involute_x_2, YComponent=involute_x, ZComponent=0, System=PlaneXY(0, 0, 0))
intcrv = Interpolate(Vertices=pt, Degree=3, Periodic=False, KnotStyle=1)  # -> Curve, Length, Domain
evaluate_2 = Evaluate(F="x/2", x=rad_3)
trim = TrimWithRegion(Curve=intcrv.Curve, Region=outsidecircle)  # -> Inside, Outside
crv = Curve(trim.Inside)
end = EndPoints(Curve=crv)  # -> Start, End
ccx = CurveCurve(CurveA=crv, CurveB=pitch_circle)  # -> Points, ParamsA, ParamsB
ln = Line(StartPoint=ccx.Points, EndPoint=center_3)
rotate = Rotate(Geometry=ln, Angle=expr("-x", division), Plane=PlaneXY(0, 0, 0))  # -> Geometry, Transform
rotate_2 = Rotate(Geometry=rotate.Geometry, Angle=expr("-x", evaluate_2), Plane=PlaneXY(0, 0, 0))  # -> Geometry, Transform
rotate_3 = Rotate(Geometry=rotate.Geometry, Angle=evaluate_2, Plane=PlaneXY(0, 0, 0))  # -> Geometry, Transform
mirror = MirrorCurve(Geometry=crv, Curve=rotate.Geometry, Tangent=True)
end_2 = EndPoints(Curve=mirror)  # -> Start, End
ln_2 = Line(StartPoint=end_2.End, EndPoint=center_3)
ccx_2 = CurveCurve(CurveA=root_circle, CurveB=rotate_3.Geometry)  # -> Points, ParamsA, ParamsB
ccx_3 = CurveCurve(CurveA=root_circle, CurveB=rotate_2.Geometry)  # -> Points, ParamsA, ParamsB
top_ln = Line(StartPoint=end.Start, EndPoint=end_2.Start)
ln_3 = Line(StartPoint=end.End, EndPoint=center_3)
trim_2 = TrimWithRegion(Curve=ln_3, Region=root_circle)  # -> Inside, Outside
trim_3 = TrimWithRegion(Curve=ln_2, Region=root_circle)  # -> Inside, Outside
crv_2 = Curve(trim_2.Outside)
crv_3 = Curve(trim_3.Outside)
join = JoinCurves(Curves=flatten([crv_2, crv, mirror, crv_3, top_ln]), Preserve=False)
trim_4 = TrimWithRegion(Curve=join, Region=root_circle)  # -> Inside, Outside
end_3 = EndPoints(Curve=trim_4.Outside)  # -> Start, End
ln_4 = Line(StartPoint=end_3.Start, EndPoint=ccx_2.Points)
ln_5 = Line(StartPoint=end_3.End, EndPoint=ccx_3.Points)
flatten = FlattenTree(Data=ln_5, Path="{0}")
flatten_2 = FlattenTree(Data=ln_4, Path="{0}")
flatten_3 = FlattenTree(Data=trim_4.Outside, Path="{0}")
join_2 = JoinCurves(Curves=[flatten_3, flatten_2, flatten], Preserve=False)
rotate_4 = Rotate(Geometry=join_2, Angle=rad_2, Plane=PlaneXY(0, 0, 0))  # -> Geometry, Transform
join_3 = JoinCurves(Curves=rotate_4.Geometry, Preserve=False)
C = ClusterOutput(join_3)
