# Grasshopper definition soporte.gh (Grasshopper 0.9.80)

# ---- group: int circle
cir = Circle(Plane=PlaneXY(0, 0, 0), Radius=Slider(0.45, range=0..2))
vec = VectorXYZ(XComponent=0, YComponent=0, ZComponent=Slider(1, range=0..1))  # -> Vector, Length
cir_2 = Circle(Plane=PlaneXY(0, 0, 0), Radius=Slider(0.607, range=0..2))
extr = Extrude(Base=cir, Direction=vec.Vector)
extr_2 = Extrude(Base=cir_2, Direction=vec.Vector)
cap = CapHoles(Brep=extr)
cap_2 = CapHoles(Brep=extr_2)

# ----
sdiff = SolidDifference(BrepsA=cap_2, BrepsB=cap)
vec_2 = VectorXYZ(XComponent=0, YComponent=Slider(1.75, range=0..10), ZComponent=0)  # -> Vector, Length
move = Move(Geometry=sdiff, Motion=vec_2.Vector)  # -> Geometry, Transform

# ---- group: triangle
pt = ConstructPoint(XCoordinate=Slider(3, range=0..10), YCoordinate=0, ZCoordinate=0)

# ---- group: circle ext
number_slider = Slider(1.26, range=0..2)
cir_3 = Circle(Plane=PlaneXY(0, 0, 0), Radius=number_slider)
vec_3 = VectorXYZ(XComponent=0, YComponent=0, ZComponent=Slider(0.35, range=0..1))  # -> Vector, Length

# ---- group: triangle (continued)
multiplication = Multiplication(A=number_slider, B=-1)
pt_2 = ConstructPoint(XCoordinate=0, YCoordinate=number_slider, ZCoordinate=0)
pt_3 = ConstructPoint(XCoordinate=0, YCoordinate=multiplication, ZCoordinate=0)
pline = PolyLine(Vertices=[pt_2, pt_3, pt], Closed=Toggle(True))

# ---- group: circle ext (continued)
extr_3 = Extrude(Base=[pline, cir_3], Direction=vec_3.Vector)
cap_3 = CapHoles(Brep=extr_3)
